# Dynamo graph 05_Write-CA-Legend.dyn (Dynamo 2.16.4.10216)

# group: Current Project
current = Document.Current()
filePath = Document.FilePath(document=current)

# group: Return the Folder of the Current Project
code_block = CodeBlock { "\\"; }
code_block_2 = CodeBlock { "\\"; }
split = String.Split(string=filePath, separator0=code_block_2)
code_block_3 = CodeBlock { -1; }
dropItems = List.DropItems(list=split, amount=code_block_3)
join = String.Join(separator=code_block, string0=dropItems)

# group: Master Check Template Location
file_path = Filename("Templates\02_Master-Check.xlsx")
file_from_path = FileObject(path=file_path)
string_from_object = FromObject(object=file_from_path)

# group: Return the File Name of the Master Check Template
code_block_4 = CodeBlock { "\\"; }
code_block_5 = CodeBlock { "\\"; }
split_2 = String.Split(string=string_from_object, separator0=code_block_5)
lastItem = List.LastItem(list=split_2)
join_2 = String.Join(separator=code_block_4, string0=lastItem)

# group: Combine Into the Current Project Path and Template Name for Master Check
code_block_6 = CodeBlock { "\\"; }
combinePath = FileSystem.CombinePath(string0=join, string1=join_2)
join_3 = String.Join(separator=code_block_6, string0=combinePath)

# group: Read from Takeoff Excel
file_from_path_2 = FileObject(path=join_3)
string = StringInput("CA")
boolean = BoolSelector(true)
boolean_2 = BoolSelector(true)
importExcel = Data.ImportExcel(file=file_from_path_2, sheetName=string, readAsStrings=boolean, showExcel=boolean_2)
code_block_7 = CodeBlock { 1; }
flatten = List.Flatten(list=importExcel, amount=code_block_7)

# group: PRODUCE
code_block_8 = CodeBlock { "MULTI-DECK PRODUCE"; }

# group: BEVERAGE
code_block_9 = CodeBlock { "MULTI-DECK SINGLE SERVE BEV"; }

# group: SERVICE DELI
code_block_10 = CodeBlock { "SERVICE DELI COLD CASE"; }
code_block_11 = CodeBlock { "SERVICE DELI HOT CASE"; }
code_block_12 = CodeBlock { "SUSHI"; }
code_block_13 = CodeBlock { "SERVICE SANDWICH"; }
code_block_14 = CodeBlock { "LOW PROFILE DELI CASE"; }
code_block_15 = CodeBlock { "MULTI-DECK DELI CASE"; }

# group: DAIRY & MEAT / DELI
code_block_16 = CodeBlock { "DAIRY COOLER DOORS (DOOR QTY x 2.5)"; }
code_block_17 = CodeBlock { "MULTI-DECK DAIRY"; }
code_block_18 = CodeBlock { "MULTI-DECK MEAT/DELI"; }
code_block_19 = CodeBlock { "TOTAL MULTI-DECK DAIRY & MEAT/DELI"; }

# group: SEAFOOD & MEAT
code_block_20 = CodeBlock { "SERVICE SEAFOOD"; }
code_block_21 = CodeBlock { "SERVICE MEAT"; }
code_block_22 = CodeBlock { "MULTI-DECK MEAT"; }

code_block_23 = CodeBlock { "WINE / LIQUOR SHELVING"; }

# group: TAB
code_block_24 = CodeBlock { "MULTI-DECK BEER / WINE"; }
code_block_25 = CodeBlock { "MULTI-DECK PREMIUM WINE"; }
wine_liquor_lf = CodeBlock(X=code_block_23) { X; }
wine_liquor_slf = CodeBlock(X=code_block_23) { X; }

# group: FROZEN FOOD
code_block_26 = CodeBlock { "MULTI-DECK FROZEN FOOD"; }
code_block_27 = CodeBlock { "MULTI-DECK FROZEN PROMO"; }
code_block_28 = CodeBlock { "MULTI-DECK FROZEN SEAFOOD & MEAT"; }
code_block_29 = CodeBlock { "TOTAL FROZEN FOOD (NUMBER OF DOORS)"; }

# group: SHELVING
code_block_30 = CodeBlock { "CENTER STORE SHELVING"; }
wine_liquor_lf_2 = CodeBlock(X=code_block_23) { X; }
code_block_31 = CodeBlock { "TOTAL SHELVING"; }

list_create = List.Create(item0=code_block_8, item1=code_block_9, item2=code_block_10, item3=code_block_11, item4=code_block_12, item5=code_block_13, item6=code_block_14, item7=code_block_15, item8=code_block_16, item9=code_block_17, item10=code_block_18, item11=code_block_19, item12=code_block_20, item13=code_block_21, item14=code_block_22, item15=code_block_24, item16=code_block_25, item17=wine_liquor_lf, item18=wine_liquor_slf, item19=code_block_26, item20=code_block_27, item21=code_block_28, item22=code_block_29, item23=code_block_30, item24=wine_liquor_lf_2, item25=code_block_31)
process_sub_headers_from_excel = Python(IN[0]=flatten, IN[1]=list_create)  # CPython3
# ---------- process_sub_headers_from_excel.python (50 lines) ----------
# Input from Excel Import Node (flattened data)
excel_data = IN[0]

# Input list of Sub-Headers to be matched
sub_headers_to_match = IN[1]

# Initialize an empty list to hold the data in the desired list of lists format
data_rows = []

try:
    # Check if sub_headers_to_match is a list
    if not isinstance(sub_headers_to_match, list):
        raise ValueError("Sub-Headers to match must be provided as a list.")

    # Create a list to track unmatched sub-headers
    unmatched_sub_headers = sub_headers_to_match.copy()

    # Iterate through each row in the Excel data
    for row in excel_data:
        # Check if the row is a valid list and has at least 6 fields
        if isinstance(row, list) and len(row) >= 6:
            # Extract and format the required data, providing sensible default values where necessary
            sub_header = row[1] if row[1] else "N/A"
            item_type = row[2] if row[2] else "N/A"
            existing = row[3] if row[3] is not None and row[3] != "" else 0
            proposed = row[4] if row[4] is not None and row[4] != "" else 0
            variation = row[5] if row[5] is not None and row[5] != "" else 0

            # Only include rows with meaningful sub-header data that matches the provided list
            if sub_header in sub_headers_to_match:
                # Create a list for the row, formatted to match the desired output structure
                row_list = [sub_header, [item_type, existing, proposed, variation]]

                # Append the row list to the data rows
                data_rows.append(row_list)

                # Remove one occurrence of the matched sub-header from unmatched list if present
                if sub_header in unmatched_sub_headers:
                    unmatched_sub_headers.remove(sub_header)

    # Check for unmatched sub-headers and raise an error if any remain
    if unmatched_sub_headers:
        raise ValueError("The following Sub-Headers were not found in the input data: {}".format(", ".join(unmatched_sub_headers)))

    # Set output to the list of lists
    OUT = data_rows if data_rows else "No valid rows found in input data. Check the structure of the input or revise the extraction logic."

except Exception as e:
    # Output any errors that occur
    OUT = "Error occurred: {}".format(str(e))
# ----------------------------------------
watch = Watch(process_sub_headers_from_excel)

# group: Extract Revit Legend
code_block_32 = CodeBlock { "DSP Comp Ref (Portrait)"; }
code_block_33 = CodeBlock { "DSP Comp Ref (Landscape)"; }
list_create_2 = List.Create(item0=code_block_32, item1=code_block_33)
get_legends = Python(IN[0]=list_create_2)  # CPython3
# ---------- get_legends.python (45 lines) ----------
import clr
clr.AddReference("RevitAPI")
clr.AddReference("RevitServices")
from Autodesk.Revit.DB import *
from RevitServices.Persistence import DocumentManager

# Inputs
doc = DocumentManager.Instance.CurrentDBDocument

# Check if input is received
if len(IN) < 1 or not IN[0]:
    OUT = "Error: Please provide a list of legend names."
    raise SystemExit

# List of legend names to find
legend_names = IN[0]

# Ensure the input is a list of strings
if not isinstance(legend_names, list) or not all(isinstance(name, str) for name in legend_names):
    OUT = "Error: Input must be a list of strings representing legend names."
    raise SystemExit

# Get all views in the document
collector = FilteredElementCollector(doc).OfClass(View)

# Filter Legends
matching_legends = []
non_matching_legends = []
for view in collector:
    if view.ViewType == ViewType.Legend:
        if view.Name.strip() in [name.strip() for name in legend_names]:
            # Append name and Element ID for matching legends
            matching_legends.append([view.Name, view.Id.IntegerValue])
        else:
            # Append name and Element ID for non-matching legends
            non_matching_legends.append([view.Name, view.Id.IntegerValue])

# Prepare Output
output_list = [
    ["Matching Legends", matching_legends],
    ["Non-Matching Legends", non_matching_legends]
]

# Output the results
OUT = output_list
# ----------------------------------------
code_block_34 = CodeBlock { 1; }
getItemAtIndex = List.GetItemAtIndex(list=get_legends@L2, index=code_block_34)
code_block_35 = CodeBlock { 0; }
getItemAtIndex_2 = List.GetItemAtIndex(list=getItemAtIndex@L2, index=code_block_35)

# group: Extract and Arrange
extract_textnotes = Python(IN[0]=getItemAtIndex_2)  # CPython3
# ---------- extract_textnotes.python (51 lines) ----------
import clr
clr.AddReference('RevitServices')
from RevitServices.Persistence import DocumentManager
clr.AddReference("RevitAPI")
from Autodesk.Revit.DB import *

# Input Legend ID
legend_id = IN[0][0]

# Access the current Revit document
doc = DocumentManager.Instance.CurrentDBDocument

# Placeholder for output
text_notes = []

try:
    # Validate that the input is a valid integer before converting to ElementId
    if isinstance(legend_id, int):
        # Try to convert legend_id to an ElementId
        legend_element_id = ElementId(legend_id)
        
        # Get the Legend View from the document
        legend_view = doc.GetElement(legend_element_id)

        # Check if the view is a Legend type
        if isinstance(legend_view, View) and legend_view.ViewType == ViewType.Legend:
            # Collect all text notes within the legend view
            collector = FilteredElementCollector(doc, legend_view.Id)
            text_elements = collector.OfCategory(BuiltInCategory.OST_TextNotes).WhereElementIsNotElementType().ToElements()
            
            # Extract text, Legend Index, position, and index from each TextNote element
            for index, text_element in enumerate(text_elements, start=1):
                if isinstance(text_element, TextNote):
                    text = text_element.Text.strip()
                    location = text_element.Coord  # Get XYZ position
                    text_notes.append([
                        text,
                        [
                            "Legend Index", index,
                            ["Position", location.X, location.Y, location.Z]
                        ]
                    ])
        else:
            text_notes.append(["Error: The provided ID does not correspond to a Legend View."])
    else:
        text_notes.append(["Error: Invalid input type. Please provide a valid integer ID."])
except Exception as e:
    text_notes.append([f"Error: An error occurred: {str(e)}"])

# Output the collected text notes
OUT = text_notes
# ----------------------------------------
code_block_36 = CodeBlock { 0.001; }
arrange_into_rows = Python(IN[0]=extract_textnotes, IN[1]=code_block_36)  # CPython3
# ---------- arrange_into_rows.python (46 lines) ----------
# Function to group elements based on Y values with a specified tolerance

def group_elements_by_y(input_list, tolerance):
    # Extract elements with Y values
    elements_with_y = []
    for item in input_list:
        if isinstance(item, list) and len(item) > 1:
            legend_index_info = item[1]
            if isinstance(legend_index_info, list) and len(legend_index_info) > 2:
                position_data = legend_index_info[2]
                if isinstance(position_data, list) and len(position_data) >= 3:
                    y_value = position_data[2]
                    elements_with_y.append((y_value, item))

    # Sort elements by Y value (descending order)
    elements_with_y.sort(key=lambda x: -x[0])

    # Group elements by Y value within the specified tolerance
    grouped_rows = []
    row_counter = 1
    current_row = []
    last_y = None

    for y_value, element in elements_with_y:
        if last_y is None or abs(last_y - y_value) <= tolerance:
            current_row.append(element)
        else:
            grouped_rows.append((f"Row {row_counter}", current_row))
            row_counter += 1
            current_row = [element]
        last_y = y_value

    # Append the last row if it exists
    if current_row:
        grouped_rows.append((f"Row {row_counter}", current_row))

    return grouped_rows

# Convert tolerance to float
tolerance = float(IN[1])

# Group the elements by Y value with the specified tolerance
output_rows = group_elements_by_y(IN[0], tolerance)

# Output the grouped rows
OUT = output_rows
# ----------------------------------------

unify_excel_and_revit_data_for = Python(IN[0]=process_sub_headers_from_excel, IN[1]=arrange_into_rows)  # "Unify Excel and Revit Data for Legend"; CPython3
# ---------- unify_excel_and_revit_data_for.python (33 lines) ----------
# Inputs
excel_data = IN[0]  # Data from Excel
revit_legend = IN[1]  # Existing Revit Legend data structure

# Function to overwrite legend data with Excel data
def overwrite_legend_data(excel_data, revit_legend):
    # Iterate through the Revit legend items
    for revit_item in revit_legend:
        if not isinstance(revit_item, list) or len(revit_item) < 2:
            # Skip invalid or improperly structured items
            continue

        title = revit_item[0]  # Title in Revit legend
        metrics = revit_item[1]  # Metrics to be overwritten

        # Match with Excel data
        for excel_item in excel_data:
            if excel_item[0] == title:  # Match titles
                # Overwrite the metrics in the Revit legend with the Excel data
                new_metrics = excel_item[1]
                metrics[0] = new_metrics[0]  # LF/DR or equivalent value
                metrics[1] = new_metrics[1]  # First value
                metrics[2] = new_metrics[2]  # Second value
                metrics[3] = new_metrics[3]  # Third value
                break  # No need to check further, move to next legend item

    return revit_legend

# Call the function to overwrite the data
overwritten_legend = overwrite_legend_data(excel_data, revit_legend)

# Output the updated legend with Excel values
OUT = overwritten_legend
# ----------------------------------------
watch_2 = Watch(unify_excel_and_revit_data_for)
watch_3 = Watch(flatten)
watch_4 = Watch(list_create)
count = List.Count(list=list_create)
watch_5 = Watch(count)
count_2 = List.Count(list=process_sub_headers_from_excel)
watch_6 = Watch(count_2)
count_3 = List.Count(list=arrange_into_rows)
watch_7 = Watch(count_3)
watch_8 = Watch(arrange_into_rows)
strip_extra_rows = Python(IN[0]=arrange_into_rows, IN[1]=list_create)  # CPython3
# ---------- strip_extra_rows.python (26 lines) ----------
import clr
clr.AddReference('ProtoGeometry')
from Autodesk.DesignScript.Geometry import *

# Inputs
input_list = IN[0]  # The input list containing all rows
desired_sub_headers = IN[1]  # The list of desired sub-headers to keep

# Function to filter rows based on Sub-Header
def filter_rows(input_list, filter_values):
    filtered_rows = []
    
    for row in input_list:
        row_name, row_data = row
        
        # Check if any item in the row matches the desired sub-headers
        if any(item[0] in filter_values for item in row_data):
            filtered_rows.append(row)
    
    return filtered_rows

# Apply filter
filtered_output = filter_rows(input_list, desired_sub_headers)

# Output
OUT = filtered_output
# ----------------------------------------
watch_9 = Watch(strip_extra_rows)
